# Grasshopper definition Relative contrast model.gh (Grasshopper 0.9.76)
# plug-ins: Python Interpreter, Ironbug

honeybee = Honeybee_Honeybee()  # -> Vviiiiiiiiiizzz; plug-in component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
ladybug = Ladybug_Ladybug()  # -> Vviiiiiiiiiizzz; plug-in component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
number_slider = Slider(0, range=0..8)
number_slider_2 = Slider(0, range=0..3)
rotationangle = Slider(1, range=1..9, expression="(x-1)*(360/9)")
int = Integer(3)
srf = Surface(<surface referenced from the Rhino model>)
rotationangle_2 = Slider(1, range=1..9, expression="(x-1)*(360/9)")

reset = Button()
bucket = CSharpScript(x=rotationangle_2, y=reset)  # -> out, A
# ---------- bucket: C# ----------
    rtnlist.Add(x);
    if((bool) y) rtnlist.Clear();

    A = rtnlist;
# ---------- bucket: C# additional code ----------
  List<object> rtnlist = new List<object>();
# ---------- end bucket ----------
panel = Panel(bucket.A)

mplane = MeshPlane(Boundary=srf, WidthCount=int, HeightCount=int)  # -> Mesh, Area
# Orientation and location
cluster = Cluster_2(
    north=Slider(45, range=0..100),
    scale=".05",
    open=Toggle(True),
    month=Slider(4, range=0..12),
    day=Slider(21, range=0..21),
    hour=Slider(10, range=0..10),
    skytype="0")
facen = FaceNormals(Mesh=mplane.Mesh)  # -> Centers, Normals

brep = Brep(<brep referenced from the Rhino model>)
brep_2 = Brep(<brep referenced from the Rhino model>)
# Surfaces and materials
define_wall = Brep([<brep referenced from the Rhino model> x4])
brep_3 = Brep(<brep referenced from the Rhino model>)
cluster_2 = Cluster(geometry_3=define_wall, geometry_2=brep, geometry_4=brep_2, geometry=brep_3)  # -> hbsurface_3, hbsurface_2, hbsurface_4, hbsurface
brep_4 = Brep(flatten([cluster_2.hbsurface_3, cluster_2.hbsurface_2, cluster_2.hbsurface_4, cluster_2.hbsurface]))

batchrun = BatchRun(mySliders=[rotationangle, number_slider_2], startme=Button())  # -> out; inputs mySliders: list, startme: Boolean
# ---------- batchrun: C# ----------
    if (!startme)
      return;

    if (_running)
      return;


    _run = true;

    _mySliders = mySliders;

    GrasshopperDocument.SolutionEnd += OnSolutionEnd;
    Print(_rtnmessage);
# ---------- batchrun: C# additional code ----------
  private bool _run = false;
  private bool _running = false;
  private List<System.Object> _mySliders;
  private string _rtnmessage;

  private void OnSolutionEnd(object sender, GH_SolutionEventArgs e)
  {
    // Unregister the event, we don't want to get called again.
    e.Document.SolutionEnd -= OnSolutionEnd;

    // If we're not supposed to run, abort now.
    if (!_run)
      return;

    //throw new System.ArgumentException("Parameter cannot be null", "something weird");

    // If we're already running, abort now.
    if (_running)
      return;

    // Reset run and running states.
    _run = false;
    _running = true;

    try
    {
      // Find the Guid for connected slides
      List<System.Guid> guids = new List<System.Guid>(); //empty list for guids
      Grasshopper.Kernel.IGH_Param selSlidersInput = Component.Params.Input[0]; //ref for input where sliders are connected to this component
      IList<Grasshopper.Kernel.IGH_Param> sources = selSlidersInput.Sources; //list of things connected on this input
      bool isAnythingConnected = sources.Any(); //is there actually anything connected?

      if (isAnythingConnected) { //if something's connected,
        foreach (var source in sources) //for each of these connected things:
        {
          IGH_DocumentObject component = source.Attributes.GetTopLevel.DocObject; //for this connected thing, bring it into the code in a way where we can access its properties
          Grasshopper.Kernel.Special.GH_NumberSlider mySlider = component as Grasshopper.Kernel.Special.GH_NumberSlider; //...then cast (?) it as a slider
          if (mySlider == null) //of course, if the thing isn't a slider, the cast doesn't work, so we get null. let's filter out the nulls
            continue;
          guids.Add(mySlider.InstanceGuid); //things left over are sliders and are connected to our input. save this guid.
          //we now have a list of guids of sliders connected to our input, saved in list var 'mySlider'
        }
      }

      // Find all sliders.
      List<Grasshopper.Kernel.Special.GH_NumberSlider> sliders = new List<Grasshopper.Kernel.Special.GH_NumberSlider>();
      foreach (IGH_DocumentObject docObject in GrasshopperDocument.Objects)
      {
        Grasshopper.Kernel.Special.GH_NumberSlider slider = docObject as Grasshopper.Kernel.Special.GH_NumberSlider;
        if (slider != null)
        {
          // check if the slider is in the selected list
          if (isAnythingConnected)
          {
            if (guids.Contains(slider.InstanceGuid)) sliders.Add(slider);
          }
          else sliders.Add(slider);
        }
      }
      if (sliders.Count == 0)
      {
        System.Windows.Forms.MessageBox.Show("No sliders could be found", "<harsh buzzing sound>", MessageBoxButtons.OK);
        return;
      }

      //we now have all sliders
      //ask the user to give a sanity check
      int totalLoops = 1;
      string message = null;
      foreach(Grasshopper.Kernel.Special.GH_NumberSlider slider in sliders)
      {
        totalLoops *= (slider.TickCount + 1);
        message += slider.ImpliedNickName;
        message += "\n";
      }
      if (System.Windows.Forms.MessageBox.Show(sliders.Count + " slider(s) connected:\n" + message + "\n" + totalLoops.ToString() + " iterations will be done. Continue?", "Start?", MessageBoxButtons.YesNo) == DialogResult.No) return;



      // Set all sliders back to zero.
      //GH_Document.EnableSolutions = false;
      foreach (Grasshopper.Kernel.Special.GH_NumberSlider slider in sliders)
        slider.TickValue = 0;

      // Start a giant loop in which we'll permutate our way across all slider layouts.
      while (true)
      {
        int idx = 0;
        if (!MoveToNextPermutation(ref idx, sliders))
          break;

        // We've just got a new valid permutation. Solve the new solution.
        e.Document.NewSolution(false);
        Rhino.RhinoDoc.ActiveDoc.Views.Redraw();
      }
    }
    catch {
      _rtnmessage = "something went wrong!";
    }
    finally {
      // Always make sure that _running is switched off.
      _running = false;
    }
  }

  private bool MoveToNextPermutation(ref int index, List<Grasshopper.Kernel.Special.GH_NumberSlider> sliders)
  {
    if (index >= sliders.Count)
      return false;

    Grasshopper.Kernel.Special.GH_NumberSlider slider = sliders[index];
    if (slider.TickValue < slider.TickCount)
    {
      // Increment the slider.
      slider.TickValue++;
      return true;
    }
    else
    {
      // The current slider is already at the maximum value. Reset it back to zero.
      slider.TickValue = 0;

      // Move on to the next slider.
      index++;

      // If we've run out of sliders to modify, we're done permutatin'
      if (index >= sliders.Count)
        return false;

      return MoveToNextPermutation(ref index, sliders);
    }
  }
# ---------- end batchrun ----------
batchrun_2 = BatchRun(mySliders=[Slider(0, range=0..10, expression="x/4"), rotationangle_2], startme=Toggle(False))  # -> out; inputs mySliders: list, startme: Boolean; same code as batchrun
item = ListItem(List=facen.Centers, Index=number_slider_2, Wrap=True)
int_2 = Integer(number_slider_2)
int_3 = Integer(rotationangle)
toggle = BooleanToggle(False)
int_4 = Integer(int_2)
concat = Concatenate(FragmentA="Test", FragmentB="_", FragmentC=int_4)
set_camera_type_to_fisheye = Panel("1")
concat_2 = Concatenate(FragmentA=concat, FragmentB="_", FragmentC=int_3)
panel_2 = Panel(concat_2)
panel_4 = Panel(concat)
imagebasedsimulation = Honeybee_ImageBasedSimulation(
    skyFile=cluster,
    cameraType=set_camera_type_to_fisheye,
    simulationType=2,
    imageWidth="600",
    imageHeight="600",
    backupImages=0)  # -> analysisRecipe; plug-in component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
rundaylightanalysis = Honeybee_RunDaylightSimulation(
    HBObjects=flatten(brep_4),
    analysisRecipe=imagebasedsimulation,
    writeRad=toggle,
    runRad=toggle,
    numOfCPUs="4",
    workingDir="C:\Cleo",
    radFileName=concat_2,
    overwriteResults=True)  # -> readMe, analysisType, resultsUnit, results, testPts, flatten(resultFiles), radGeoFile, studyFolder, done; plug-in component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

# ----
# Relative Contrast component
item_2 = ListItem(List=rundaylightanalysis.studyFolder, Index=0, Wrap=True)
panel_5 = Panel(item_2)
relative_contrast = PythonScript(runIt=Toggle(False), imageDir=panel_5)  # -> RCPI, HDR_image
# ---------- relative_contrast: Python ----------
# -*- coding: utf-8 -*-
"""
Created on Thu Oct 26 11:04:00 2017

@author: mkj

Visual discomfort in buildings are often based on Daylight Glare Probability (DGP) index. DGP is used to quantify the percentage probability of glare perception under daylight conditions. 
Due to the structure of the formula, the DGP index only consider the discomfort due to high contrast between the center of the field of view and the surroundings to a limited extend. The Relative Contrast model can be used to detect potential visual discomfort based on the relative contrast in the field of view.  

In this component HDR images with angular fisheye perspective rendered by Radiance in Honeybee for Grasshopper are used for the investigation. The average luminance in the scene is calculated by Evalglare for each rendered image.

To assess the contrast, the illuminance of each pixel is derived using their RGB values. The relative contrast between the illuminance of the pixels is based on the standard deviation and weighted by their position index.


"""

#Some constants
NUMBER_OF_IMAGES= 1
IMAGE_SIZE= 600

from subprocess import *
import math

#Subprocess processing cmd with arguments. Returns standard output and error 
def runCmd(args):
      process= Popen(['cmd']+list(args),stdout= PIPE,stderr= PIPE)
      out= []
      while process.poll() is None:
        line= process.stdout.readline()
        if line!= '' and line.endswith('\n'):
          out.append(line[:-1])
      stdout,stderr= process.communicate()
      out+= stdout.split('\n')  
      return out

if runIt:
  
    #Directions to folders
    rootDir= "C:\\Radiance\\bin\\"
    #rootDir contains evalglare.exe, solid_angles_with_posx2.txt, LumFromHdr.jar

    args= ['/k','dir','/b',imageDir+'*.hdr']
    imageFiles= runCmd(args)
    #avgdata= array with average luminance values from evalglare.exe 
    avgdata= []
    for index in range(0,NUMBER_OF_IMAGES):
      args= ['/k',rootDir+'evalglare.exe','-d','-vth','-vv','180','-vh','180',imageDir+imageFiles[index]]
      data= runCmd(args)
      for index2 in range(len(data)):
          if data[index2].find(': ')!=-1:
              line=data[index2].split(": ")
              values= line[1].split(" ")
              avgdata.append(values[1])

    big= open(rootDir +"solid_angles_with_posx2.txt","r")
    lines= big.read().splitlines()
    big.close
    
    #Making matrix with values from solid_angles_with_posx2.txt
    w= len(lines[0].split(" "))
    h= len(lines)
    
    solidanglewposition= [[0 for y in range(h)] for x in range(w)]
    
    for y in range(h):
      items= lines[y].split(" ")
      for x in range(w):
        solidanglewposition[x][y]= float(items[x])
    
    #Creating a matrix with NaN's
    omegaIndex=[[0 for y in range(IMAGE_SIZE)] for x in range(IMAGE_SIZE)]
    for y in range(IMAGE_SIZE):
      for x in range(IMAGE_SIZE):
        omegaIndex[x][y]= float("NaN")
    
    #Building matrix omegaIndex with solid angle data 
    for y in range(h):
      omegaIndex[int(solidanglewposition[0][y])][int(solidanglewposition[1][y])-1]= solidanglewposition[2][y]*solidanglewposition[3][y] 
    
    lumFloatData= []
    for index in range(NUMBER_OF_IMAGES):
      #Use LumFromPic.jar to make luminance values for each pixels in the actual hdr-file 
      args= ['/k','java','-jar',rootDir+'LumFromHdr.jar',imageDir+imageFiles[index],rootDir+'lumValues.csv']
      notUsed= runCmd(args)
      
      #Read the luminance values into the luminance matrix
      lumFile= open(rootDir+"lumValues.csv",'r')
      lines= lumFile.read().splitlines()
      lumFile.close()
      luminance= [[0 for x in range(IMAGE_SIZE)] for y in range(IMAGE_SIZE)]
      for y in range(IMAGE_SIZE):
        items= lines[y].split(";")
        for x in range(IMAGE_SIZE):
          luminance[x][y]= float(items[x])
    
      #Building matrix lumMulOmega by element-wise multiplication from omegaIndex and luminance 
      lumMulOmega= [[0 for y in range(IMAGE_SIZE)] for x in range(IMAGE_SIZE)] 
      for y in range(IMAGE_SIZE):
       for x in range(IMAGE_SIZE):
        lumMulOmega[x][y]= omegaIndex[x][y]*luminance[x][y]
    
      #Calculating meanvalue
      antal= 0.0; sum= 0.0
      for y in range(IMAGE_SIZE):
        for x in range(IMAGE_SIZE):
          if not math.isnan(lumMulOmega[x][y]):
            antal+= 1.0
            sum+= lumMulOmega[x][y]
      
      #Calculating standard deviation
      mean= sum/antal
      sum= 0.0
      for y in range(IMAGE_SIZE):
        for x in range(IMAGE_SIZE):
          if not math.isnan(lumMulOmega[x][y]):
            sum+= (lumMulOmega[x][y]-mean)**2
      std= math.sqrt(sum/antal)
      
      #Formala equals standard deviation / average luminance from Evalglare
      lumFloatData.append(std/float(avgdata[index]))
    
    #results as string with 8 decimals
    lumdata= []
    for index in range(NUMBER_OF_IMAGES):
      lumdata.append('%.8f'%lumFloatData[index])
    
    print(lumdata)
# ---------- end relative_contrast ----------
# TO DO:
# - Figure out how to render nine images at the same time
# - Visualize data
# - Incorporate some sort of user-friendly error messages in case of wrong inputs
panel_6 = Panel(relative_contrast.RCPI)

glareanalysis = Honeybee_GlareAnalysis(HDRImagePath=rundaylightanalysis.resultFiles, runIt=Toggle(True))  # -> readMe, glareCheckImage, DGP, DGI, glareComfortRange, imageWithTaskArea; plug-in component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
# Honeybee glare analysis
toggle_2 = BooleanToggle(False)
hdr_gif = Honeybee_ConvertHDRToGIF(HDRFilePath=rundaylightanalysis.resultFiles, adjustExposure=toggle_2)  # -> GIFFilePath; plug-in component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
viewer = Ladybug_ImageViewer(ImagePath_=hdr_gif, _scale_=1, DisableClickable=False, SaveImgWithCoords=False, scale=1)  # -> ImagePath, Colors, GIF

pt = Point(item)
comfortmannequin = Ladybug_ComfortMannequin(rotationAngle=rotationangle, bodyLocation=pt)  # -> mannequinMesh, legend, legendBasePt; plug-in component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

# ----
# set the view
panel_7 = Panel(pt)

# ---- group: Person's face!
item_3 = ListItem(List=comfortmannequin.mannequinMesh, Index=121, Wrap=True)

# ----
facen_2 = FaceNormals(Mesh=item_3)  # -> Centers, Normals

preview = CustomPreview(Geometry=item_3, Shader=ColourSwatch(SwatchColor=RGB(255, 0, 0)))

settheview = Ladybug_SetTheView(cameraLocation=facen_2.Centers, cameraDirection=facen_2.Normals)  # plug-in component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

# ==== cluster Cluster
# Assign window properties
panel = Panel("glass")
radglassmaterial = Honeybee_RadianceGlassMaterial(materialName=panel, RTransmittance="0.68", GTransmittance="0.68", BTransmittance="0.68", refractiveIndex=1.52)  # -> avrgTrans, RADMaterial; plug-in component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
geometry = ClusterInput()
geometry_2 = ClusterInput()
geometry_3 = ClusterInput()
geometry_4 = ClusterInput()
createhbsrfs = Honeybee_createHBSrfs(geometry=geometry, srfType="5", RADMaterial=radglassmaterial.RADMaterial)  # -> readMe, simplify(HBSurface); plug-in component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
createhbsrfs_2 = Honeybee_createHBSrfs(geometry=geometry_2, srfType="3")  # -> readMe, simplify(HBSurface); plug-in component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
# Define geometry
createhbsrfs_3 = Honeybee_createHBSrfs(geometry=geometry_3, srfType="0")  # -> readMe, simplify(HBSurface); plug-in component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
createhbsrfs_4 = Honeybee_createHBSrfs(geometry=geometry_4, srfType="2")  # -> readMe, simplify(HBSurface); plug-in component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
hbsurface = ClusterOutput(createhbsrfs.HBSurface)
hbsurface_2 = ClusterOutput(createhbsrfs_2.HBSurface)
hbsurface_3 = ClusterOutput(createhbsrfs_3.HBSurface)
hbsurface_4 = ClusterOutput(createhbsrfs_4.HBSurface)

# ==== cluster Cluster_2
north = ClusterInput()
scale = ClusterInput()
open = ClusterInput()
northarrow = Ladybug_North(north=north, scale=scale)  # -> northSign; plug-in component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
open_weather_file = Ladybug_OpenEPWWeatherFile(open=open)  # -> epwFile; plug-in component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
month = ClusterInput()
day = ClusterInput()
hour = ClusterInput()
skytype = ClusterInput()
genstandardciesky = Honeybee_GenerateStandardCIESky(north=northarrow, weatherFile=open_weather_file, month=month, day=day, hour=hour, skyType=skytype)  # -> skyFilePath; plug-in component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
skyfilepath = ClusterOutput(genstandardciesky)
