# Grasshopper definition Zebra.gh (Grasshopper 0.9.76)
# plug-ins: Python Interpreter

honeybee = Honeybee_Honeybee()  # -> out; plug-in component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
ladybug = Ladybug_Ladybug()  # -> out; plug-in component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

# ----
# Weather and location definition
boolean_toggle = BooleanToggle(True)
northarrow = Ladybug_North()  # -> northSign; plug-in component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
open_weather_file = Ladybug_OpenEPWWeatherFile(open=boolean_toggle)  # -> epwFile; plug-in component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
genstandardciesky = Honeybee_GenerateStandardCIESky(
    north=northarrow,
    weatherFile=open_weather_file,
    month=Slider(7, range=1..12),
    day=Slider(9, range=1..31),
    hour=Slider(14, range=0..24),
    skyType=Slider(0, range=0..5))  # -> skyFilePath; plug-in component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

# ----
# Honeybee Surfaces
panel = Panel("0.68")
surface = Surface(<surface referenced from the Rhino model>)
integer = Integer(5)
integer_2 = Integer(0)
surface_2 = Surface(<surface referenced from the Rhino model>)
integer_3 = Integer(3)
surface_3 = Surface([<surface referenced from the Rhino model> x4])
integer_4 = Integer(2)
radglassmaterial = Honeybee_RadianceGlassMaterial(materialName="glass", RTransmittance=panel, GTransmittance=panel, BTransmittance=panel, refractiveIndex=1.52)  # -> avrgTrans, RADMaterial; plug-in component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
createhbsrfs = Honeybee_createHBSrfs(geometry=surface_2, srfType=integer_3)  # -> out, simplify(HBSurface); plug-in component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
createhbsrfs_2 = Honeybee_createHBSrfs(geometry=surface_3, srfType=integer_2)  # -> out, simplify(HBSurface); plug-in component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
createhbsrfs_3 = Honeybee_createHBSrfs(geometry=surface, srfType=integer, RADMaterial=radglassmaterial.RADMaterial)  # -> out, simplify(HBSurface); plug-in component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
surface_4 = Surface(<surface referenced from the Rhino model>)
createhbsrfs_4 = Honeybee_createHBSrfs(geometry=surface_4, srfType=integer_4)  # -> out, simplify(HBSurface); plug-in component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

brep = Brep(flatten([createhbsrfs_2.HBSurface, createhbsrfs.HBSurface, createhbsrfs_4.HBSurface, createhbsrfs_3.HBSurface]))
# Generating .hdr images for further analysis
imagebasedsimulation = Honeybee_ImageBasedSimulation(skyFile=genstandardciesky, cameraType="1", simulationType=2, imageWidth="600", imageHeight="600", backupImages=0)  # -> analysisRecipe; plug-in component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
boolean_toggle_2 = BooleanToggle(False)
rotationangle = Slider(1, range=1..9, expression="40*(x-1)")
runevalglare = RunEvalglare(runIt=Toggle(False), imageDir="C:\Cleo\")  # -> transfer
# ---------- runevalglare: Python ----------
"""
Connects images til be analysed in Evalglare, provided by Radiance. Calculates DGP, XX, XX.. 
-----
Please notice that only HDR images can be analyzed 
-----

    Args:
        runIt: Set to 'True' to run analysis
        imageDir: Input directory for .HDR as str
    Returns:
        transfer: Output are given as a string 
"""
import os
import glob
from subprocess import* 

def runCmd(args):
    process=Popen(['cmd']+list(args),stdout=PIPE, stderr=PIPE)
    out=[]
    while process.poll() is None: 
        line=process.stdout.readline()
        if line!= '' and line.endswith('\n'):
            out.append(line[:-1])
        stdout,stderr=process.communicate()
        out+=stdout.split('\n')
        return out 

#Sorting images in folder in correct order
def alphaNumericSort(value):
    parts=value.split('_')
    return int(parts[1])*1000+int(parts[2])

#Directory to images
#Directory to evalglare.exe
evalglare='C:\\Radiance\\bin\\'

runIt= True
if runIt:
    maps=sorted(glob.glob(imageDir+'image_*'),key=alphaNumericSort) 
    hdrFiles=[]
    noOfAngles=0
    for t in range(len(maps)):
        prefix=maps[t].split(imageDir[1:])[1]
        fileName=maps[t]+'\\imageBasedSimulation\\'+prefix+'_IMG_Perspective.hdr'
        if prefix.find('_0_') > -1: 
            noOfAngles+=1
        hdrFiles.append(fileName) 

    noOfPoints=int(len(hdrFiles)/noOfAngles)    
    EvalglareData=['dgp', 'dgi', 'ugr', 'vcp', 'cgi', 'Lveil']
    noOfValues=len(EvalglareData) 

    text= ''
    #Running evalglare.exe on hdrfiles with parameters and collecting results
    for t in range(len(hdrFiles)):
        data=runCmd(['/k',evalglare+'evalglare.exe','-vth', '-vv', '180', '-vh', '180',hdrFiles[t]])
        text+= str(data[0].split(': ')[1])[:-2]
        #units= str(data[0].split(': ')[1])        
        #print(units)
        #text+= units[:-2]
    transfer= str(noOfPoints)+' '+str(noOfAngles)+' '+str(noOfValues)+' '+text[:-1]
# ---------- end runevalglare ----------
rotationangle_2 = Slider(4, range=1..9, expression="40*(x-1)")
evalglarevalue = EvalglareValue({"DGP": 0, "DGI": 1, "UGR": 2, "VCP": 3, "CGI": 4, "Levill": 5}, selected="DGP")
relative_contrast = RelativeContrast(runIt=Toggle(False), imageDir="C:Cleo\")  # -> transfer
# ---------- relative_contrast: Python ----------
import os
import glob
import math
from subprocess import *

def runCmd(args):
  process= Popen(['cmd']+list(args),stdout= PIPE,stderr= PIPE)
  out= []
  while process.poll() is None:
    line= process.stdout.readline()
    if line!= '' and line.endswith('\n'):
      out.append(line[:-1])
  stdout,stderr= process.communicate()
  out+= stdout.split('\n')
  return out

def alphaNumericSort(value):
  parts= value.split('_')
  return int(parts[1])*361+int(parts[2])

IMAGE_SIZE= 600
progDir= 'c:\\radiance\\bin\\'

if runIt:
  runIt= False  
  maps= sorted(glob.glob(imageDir+'image_*'),key= alphaNumericSort)
  hdrFiles= []
  noOfAngles= 0
  for t in range(0,len(maps)):
    prefix= maps[t].split(imageDir[1:])[1]
    fileName= maps[t]+'\\imageBasedSimulation\\'+prefix+'_IMG_Perspective.hdr'
    if prefix.find('_0_') > -1:
      noOfAngles+= 1
    hdrFiles.append(fileName)

  noOfPoints= int(len(hdrFiles)/noOfAngles)
  
  big= open(progDir +"solid_angles_with_posx2.txt","r")
  lines= big.read().splitlines()
  big.close
    
  #Making matrix with values from solid_angles_with_posx2.txt
  w= len(lines[0].split(" "))
  h= len(lines)
    
  solidanglewposition= [[0 for y in range(h)] for x in range(w)]
  
  for y in range(h):
    items= lines[y].split(" ")
    for x in range(w):
      solidanglewposition[x][y]= float(items[x])
    
  #Creating a matrix with NaN's
  omegaIndex=[[0 for y in range(IMAGE_SIZE)] for x in range(IMAGE_SIZE)]
  for y in range(IMAGE_SIZE):
    for x in range(IMAGE_SIZE):
      omegaIndex[x][y]= float("NaN")
    
  #Building matrix omegaIndex with solid angle data 
  for y in range(h):
    omegaIndex[int(solidanglewposition[0][y])][int(solidanglewposition[1][y])-1]= solidanglewposition[2][y]*solidanglewposition[3][y]
  
  contrast= []
  for index in range(len(hdrFiles)):
    #Use LumFromPic.jar to make luminance values for each pixels in the actual hdr-file     
    args= ['/k','java','-jar',progDir+'LumFromHdr.jar',hdrFiles[index],progDir+'lumValues.csv']
    notUsed= runCmd(args)
      
    #Read the luminance values into the luminance matrix
    lumFile= open(progDir+'lumValues.csv','r')
    lines= lumFile.read().splitlines()
    lumFile.close()
    luminance= [[0 for x in range(IMAGE_SIZE)] for y in range(IMAGE_SIZE)]
    for y in range(IMAGE_SIZE):
      items= lines[y].split(";")
      for x in range(IMAGE_SIZE):
        luminance[x][y]= float(items[x])
    
    #Building matrix lumMulOmega by element-wise multiplication from omegaIndex and luminance 
    lumMulOmega= [[0 for y in range(IMAGE_SIZE)] for x in range(IMAGE_SIZE)] 
    for y in range(IMAGE_SIZE):
     for x in range(IMAGE_SIZE):
      lumMulOmega[x][y]= omegaIndex[x][y]*luminance[x][y]
    
    #Calculating meanvalue
    antal= 0.0; sum= 0.0
    for y in range(IMAGE_SIZE):
      for x in range(IMAGE_SIZE):
        if not math.isnan(lumMulOmega[x][y]):
          antal+= 1.0
          sum+= lumMulOmega[x][y]
      
    #Calculating standard deviation
    mean= sum/antal
    sum= 0.0
    for y in range(IMAGE_SIZE):
      for x in range(IMAGE_SIZE):
        if not math.isnan(lumMulOmega[x][y]):
          sum+= (lumMulOmega[x][y]-mean)**2
    std= math.sqrt(sum/antal)
    result= std/mean
    contrast.append(result)
  
  t= 0
  text= ''
  for x in range(noOfPoints):
    for y in range(noOfAngles):
      twoDec= format(contrast[t],'.2f')
      text+= twoDec+' '
      t+= 1
  transfer= str(noOfPoints)+' '+str(noOfAngles)+' '+str(text)
# ---------- end relative_contrast ----------
relativecontrast_output = RelativeContrast_output(transfer=relative_contrast, rotationAngle=rotationangle, runIt=Toggle(True))  # -> out, asList
# ---------- relativecontrast_output: Python ----------
if runIt:
  text= str(transfer)  
  units= text.split(' ')  
  if len(units) > 1:  
    noOfPoints= int(units[0])
    noOfAngles= int(units[1])

    matrix= [[0 for y in xrange(noOfAngles)] for x in xrange(noOfPoints)]
  
    t=0
    for x in range(noOfPoints):
      for y in range(noOfAngles):
        matrix[x][y]= units[t+2]
        t+=1
 
    print('Result for rotationangle '+str(int(rotationAngle))+':')
    rotationAngle/= 40
      
    for x in range(noOfPoints):
      print('Point_'+str(x)+': '+matrix[x][int(rotationAngle)])  
    asList=[]
    for x in range(noOfPoints):
        asList.append(str(matrix[x][int(rotationAngle)]))
# ---------- end relativecontrast_output ----------
# DGP Index: Intolerable glare: => 0.45
# Disturbing glare: 0.45>DGP=>0.4
# Perceptible glare 0.4>=>0.35
# Imperceptible glare 0.35>DGP
evalglare_output = Evalglare_output(transfer=runevalglare, runIt=Toggle(True), rotationAngle=rotationangle_2, EvalglareValue=evalglarevalue)  # -> out, asList
# ---------- evalglare_output: Python ----------
"""
Processes results from Evalglare.
-----

    Args:
        runIt: Set to 'True' to run analysis
        imageDir: Input directory for .HDR as str
        rotationAngle: Insert rotationAngle slider 
        EvalglareValue: Insert valuelist 
    Returns:
        out: Output are given as a string 
"""
if runIt:
  runIt= False
  text= str(transfer)
  units= text.split(' ')
  
  noOfPoints= int(units[0])
  noOfAngles= int(units[1])
  noOfValues= int(units[2])

  EvalglareData= ['DGP','DGI','UGR','VCP','CGI','Levill']
  matrix= [[[0 for z in xrange(noOfValues)] for y in xrange(noOfAngles)] for x in xrange(noOfPoints)]
  
  t=0
  for x in range(noOfPoints):
    for y in range(noOfAngles):
      for z in range(noOfValues):
        matrix[x][y][z]= units[t+3]
        t+=1

print(EvalglareData[EvalglareValue]+' for rotationangle '+str(int(rotationAngle))+':')
rotationAngle/= 40      
for x in range(noOfPoints):
  see= str(matrix[x][int(rotationAngle)][EvalglareValue])
  print('Point_'+str(x)+': '+see)
     
asList=[]
for x in range(noOfPoints):
  asList.append(str(matrix[x][int(rotationAngle)][EvalglareValue]))
# ---------- end evalglare_output ----------
panel_2 = Panel(relativecontrast_output.out)
colorsrfmap = ColorSrfMap(srf=createhbsrfs_4.HBSurface, values=evalglare_output.asList)
panel_3 = Panel(evalglare_output.out)

surface_5 = Surface(<surface referenced from the Rhino model>)
integer_5 = Integer(3)
mesh_plane = MeshPlane(Boundary=surface_5, WidthCount=integer_5, HeightCount=integer_5)  # -> Mesh, Area
position_of_view = Slider(0, range=0..8)
rotationangle_3 = Slider(1, range=1..9, expression="(x-1)*(360/9)")
face_normals = FaceNormals(Mesh=mesh_plane.Mesh)  # -> Centers, Normals
batchrun = BatchRun(mySliders=[rotationangle_3, position_of_view], startme=Button())  # -> out; inputs mySliders: list, startme: Boolean
# ---------- batchrun: C# ----------
    if (!startme)
      return;

    if (_running)
      return;


    _run = true;

    _mySliders = mySliders;

    GrasshopperDocument.SolutionEnd += OnSolutionEnd;
    Print(_rtnmessage);
# ---------- batchrun: C# additional code ----------
  private bool _run = false;
  private bool _running = false;
  private List<System.Object> _mySliders;
  private string _rtnmessage;

  private void OnSolutionEnd(object sender, GH_SolutionEventArgs e)
  {
    // Unregister the event, we don't want to get called again.
    e.Document.SolutionEnd -= OnSolutionEnd;

    // If we're not supposed to run, abort now.
    if (!_run)
      return;

    //throw new System.ArgumentException("Parameter cannot be null", "something weird");

    // If we're already running, abort now.
    if (_running)
      return;

    // Reset run and running states.
    _run = false;
    _running = true;

    try
    {
      // Find the Guid for connected slides
      List<System.Guid> guids = new List<System.Guid>(); //empty list for guids
      Grasshopper.Kernel.IGH_Param selSlidersInput = Component.Params.Input[0]; //ref for input where sliders are connected to this component
      IList<Grasshopper.Kernel.IGH_Param> sources = selSlidersInput.Sources; //list of things connected on this input
      bool isAnythingConnected = sources.Any(); //is there actually anything connected?

      if (isAnythingConnected) { //if something's connected,
        foreach (var source in sources) //for each of these connected things:
        {
          IGH_DocumentObject component = source.Attributes.GetTopLevel.DocObject; //for this connected thing, bring it into the code in a way where we can access its properties
          Grasshopper.Kernel.Special.GH_NumberSlider mySlider = component as Grasshopper.Kernel.Special.GH_NumberSlider; //...then cast (?) it as a slider
          if (mySlider == null) //of course, if the thing isn't a slider, the cast doesn't work, so we get null. let's filter out the nulls
            continue;
          guids.Add(mySlider.InstanceGuid); //things left over are sliders and are connected to our input. save this guid.
          //we now have a list of guids of sliders connected to our input, saved in list var 'mySlider'
        }
      }

      // Find all sliders.
      List<Grasshopper.Kernel.Special.GH_NumberSlider> sliders = new List<Grasshopper.Kernel.Special.GH_NumberSlider>();
      foreach (IGH_DocumentObject docObject in GrasshopperDocument.Objects)
      {
        Grasshopper.Kernel.Special.GH_NumberSlider slider = docObject as Grasshopper.Kernel.Special.GH_NumberSlider;
        if (slider != null)
        {
          // check if the slider is in the selected list
          if (isAnythingConnected)
          {
            if (guids.Contains(slider.InstanceGuid)) sliders.Add(slider);
          }
          else sliders.Add(slider);
        }
      }
      if (sliders.Count == 0)
      {
        System.Windows.Forms.MessageBox.Show("No sliders could be found", "<harsh buzzing sound>", MessageBoxButtons.OK);
        return;
      }

      //we now have all sliders
      //ask the user to give a sanity check
      int totalLoops = 1;
      string message = null;
      foreach(Grasshopper.Kernel.Special.GH_NumberSlider slider in sliders)
      {
        totalLoops *= (slider.TickCount + 1);
        message += slider.ImpliedNickName;
        message += "\n";
      }
      if (System.Windows.Forms.MessageBox.Show(sliders.Count + " slider(s) connected:\n" + message + "\n" + totalLoops.ToString() + " iterations will be done. Continue?", "Start?", MessageBoxButtons.YesNo) == DialogResult.No) return;



      // Set all sliders back to zero.
      //GH_Document.EnableSolutions = false;
      foreach (Grasshopper.Kernel.Special.GH_NumberSlider slider in sliders)
        slider.TickValue = 0;

      // Start a giant loop in which we'll permutate our way across all slider layouts.
      while (true)
      {
        int idx = 0;
        if (!MoveToNextPermutation(ref idx, sliders))
          break;

        // We've just got a new valid permutation. Solve the new solution.
        e.Document.NewSolution(false);
        Rhino.RhinoDoc.ActiveDoc.Views.Redraw();
      }
    }
    catch {
      _rtnmessage = "something went wrong!";
    }
    finally {
      // Always make sure that _running is switched off.
      _running = false;
    }
  }

  private bool MoveToNextPermutation(ref int index, List<Grasshopper.Kernel.Special.GH_NumberSlider> sliders)
  {
    if (index >= sliders.Count)
      return false;

    Grasshopper.Kernel.Special.GH_NumberSlider slider = sliders[index];
    if (slider.TickValue < slider.TickCount)
    {
      // Increment the slider.
      slider.TickValue++;
      return true;
    }
    else
    {
      // The current slider is already at the maximum value. Reset it back to zero.
      slider.TickValue = 0;

      // Move on to the next slider.
      index++;

      // If we've run out of sliders to modify, we're done permutatin'
      if (index >= sliders.Count)
        return false;

      return MoveToNextPermutation(ref index, sliders);
    }
  }
# ---------- end batchrun ----------

listconvert = ListConvert(list=face_normals.Centers, x=integer_5, y=integer_5)  # -> out, a; inputs list: list
# ---------- listconvert: Python ----------
a=[]
for t in range(x):
    for s in range(y):
        a.append(list[s*x+t])
# ---------- end listconvert ----------

list_item = ListItem(List=listconvert.a, Index=position_of_view, Wrap=True)
point = Point(list_item)

naming_images = NamingImages(integer_2=rotationangle_3, integer=position_of_view)

# ----
# Setting the view
comfortmannequin = Ladybug_ComfortMannequin(rotationAngle=rotationangle_3, bodyLocation=point)  # -> mannequinMesh, legend, legendBasePt; plug-in component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
list_item_2 = ListItem(List=comfortmannequin.mannequinMesh, Index=121, Wrap=True)
face_normals_2 = FaceNormals(Mesh=list_item_2)  # -> Centers, Normals
custom_preview = CustomPreview(Geometry=list_item_2, Shader=ColourSwatch(SwatchColor=RGB(255, 0, 0)))
settheview = Ladybug_SetTheView(cameraLocation=face_normals_2.Centers, cameraDirection=face_normals_2.Normals)  # plug-in component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

rundaylightanalysis = Honeybee_RunDaylightSimulation(
    HBObjects=flatten(brep),
    analysisRecipe=imagebasedsimulation,
    writeRad=boolean_toggle_2,
    runRad=boolean_toggle_2,
    numOfCPUs="4",
    workingDir="C:\Cleo\",
    radFileName=naming_images,
    overwriteResults=True)  # -> readMe, analysisType, resultsUnit, results, testPts, flatten(resultFiles), radGeoFile, studyFolder, done; plug-in component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

# ==== cluster NamingImages
integer = ClusterInput()
integer_2 = ClusterInput()
integer_3 = Integer(integer_2)
integer_4 = Integer(integer)
concatenate = Concatenate(FragmentA="image", FragmentB="_", FragmentC=integer_4)
concatenate_2 = Concatenate(FragmentA=concatenate, FragmentB="_", FragmentC=integer_3)
R = ClusterOutput(concatenate_2)

# ==== cluster ColorSrfMap: Colors a mesh depending on assigned values
srf = ClusterInput()
number_slider = Slider(3, range=0..10)
values = ClusterInput()
srf_2 = Surface(srf)
divide = DivideDomain²(Domain=srf_2, UCount=number_slider, VCount=number_slider)
sort = SortList(Keys=values)  # -> reverse(Keys), ValuesA
sort_2 = SortList(Keys=values)  # -> Keys, ValuesA
num = Number(values)
subsrf = Isotrim(Surface=srf_2, Domain=divide)
item = ListItem(List=sort_2.Keys, Index=0, Wrap=True)
item_2 = ListItem(List=sort.Keys, Index=0, Wrap=True)
mesh = Mesh(subsrf)
gradient = Gradient(LowerLimit=item, UpperLimit=item_2, Parameter=num, stops=[0: RGB(0, 128, 0), 0.5: RGB(255, 255, 0), 1: RGB(255, 0, 0)])
mcol = MeshColours(Mesh=graft(mesh), Colours=graft(gradient))
mjoin = MeshJoin(Meshes=flatten(mcol))
weld_mesh = WeldMesh(Mesh=mjoin, Angle=3.141592654)
result = ClusterOutput(weld_mesh)
